vi "PackageDetails.gviweb"   [LabVIEW NXG Preview 4.0.0]
panel controls:
  "Download": bool
panel indicators:
  "URL Image": string
  "Name": string
  "PkgIcon": string
  "ReleaseDate": string
  "Vendor": string
  "Author": string
  "Description": string
  "Release Notes": string
  "Dependencies": string
  "Version": string
  "PrototypedBy": string
types:
  "Package Version.gtype" = cluster{"ReleaseDate": string, "Version": string, "DisplayName": string, "Description": string, "Vendor": string, "Author": string, "Release Notes": string, "Dependencies": string[], "IconURL": string, "PackageURL": string}
  T1 = cluster{"BaseURL": string, "Package Details": "Package Version.gtype"}
uses:
  QMH support::Message Queue::Create All Message Queues.gviweb
  HTTP Client API::Base URL--constant.gvi
  QMH support::Message Queue::Dequeue Message.gviweb
  QMH support::Message Queue::Enqueue Message (Single).gviweb
  BusyStateAPI::BusyStateAPI.jsli::SetBusy
  HTTP Client API::Connection::Open Connection.gvi
  HTTP Client API::Packages::Get Package Details.gvi
  HTTP Client API::Connection::Close Connection.gvi
  BusyStateAPI::BusyStateAPI.jsli::UnsetBusy
  WebApp::Support::JSON Timestamp to Display.gvi
  WebApp::Support::Join Strings.gvi
  RedirectURL::Redirect.jsli::Redirect
  NI::G Core::Error::Read Error Code.gvi
  Error Handling::Error Handler.gvi
  NI::G Core::Error::Build Error Cluster.gvi
  QMH support::Error Handler - Message Handling Loop.gviweb
  QMH support::Error Handler - Event Handling Loop.gviweb
diagram:
  w1 = bool TRUE  # Stop Event
  Create User Event[EventName="Stop Event"](user event data type=w1) -> (error out=w2, user event out=w3)
  call "Create All Message Queues.gviweb"(error in=w2) -> (message queues=w4, error out=w5)
  call "Base URL--constant.gvi"() -> (Base URL=w6)
  Property Node(instance in=T1 {all zero or empty}, "BaseURL"=w6) -> (instance out=w7)
  Property Node(instance in=w4) -> ("UI"=w8)
  s1 = w7  # shift register
  while {
    call "Dequeue Message.gviweb"(message queue in=w8, error in=w5) -> (message queue out=w9, message=w10, message data=w11, error out=w12)
    # s1: Data
    # w3: Stop Event
    case (w10) ignore case {  # Message Cases
      frame "Initialize" {
        call "Enqueue Message (Single).gviweb"(message queue in=w9, message="Get Package Details", error in=w12) -> (error out=w13)
        w14 = s1
        w15 = default
      }
      frame "Get Package Details" {
        Property Node(instance in=s1) -> ("BaseURL"=w16, instance out=w17)
        call "SetBusy"(error in=w12) -> (error out=w18)
        call "Open Connection.gvi"(Root URL=w16, error in=w18) -> (Connection=w19, error out=w20)
        call "Get Package Details.gvi"(Connection in=w19, error in=w20) -> (Connection out=w21, Package Details=w22, error out=w23)
        Property Node(instance in=w17, "Package Details"=w22) -> (instance out=w14)
        call "Close Connection.gvi"(Connection in=w21, error in=w23) -> (error out=w24)
        call "UnsetBusy"(error in=w24) -> (error out=w25)
        call "Enqueue Message (Single).gviweb"(message queue in=w9, message="Display Package Details", error in=w25) -> (error out=w13)
        w15 = default
      }
      frame "Display Package Details" {
        Property Node(instance in=s1) -> ("Package Details"=w26, instance out=w14)
        Property Node(instance in=w26) -> ("DisplayName"=w27, "Version"=w28, "IconURL"=w29, "ReleaseDate"=w30, "Vendor"=w31, "Author"=w32, "Description"=w33, "Release Notes"=w34, "Dependencies"=w35)
        $Name <- w27
        $Version <- w28
        $PkgIcon <- w29
        call "JSON Timestamp to Display.gvi"(JSON Timestamp=w30) -> (Display Timestamp=w36)
        $ReleaseDate <- w36
        $Vendor <- w31
        $Author <- w32
        $Description <- w33
        $"Release Notes" <- w34
        call "Join Strings.gvi"(String Array Input=w35, Separator="\r\n") -> (String output=w37)
        $Dependencies <- w37
        w13 = w12
        w15 = default
      }
      frame "Download Package" {
        Property Node(instance in=s1) -> ("Package Details:PackageURL"=w38, instance out=w14)
        call "SetBusy"(error in=w12) -> (error out=w39)
        call "Redirect"(URL=w38, target="_blank", error in=w39) -> (error out=w40)
        call "UnsetBusy"(error in=w40) -> (error out=w13)
        w15 = default
      }
      frame "Error" {
        # Process Error
        w41 = no error  # Error
        Unflatten From JSON(JSON string=w11, error in (no error)=w12, type and defaults=w41) -> (error out=w13, value=w42)
        call "Read Error Code.gvi"(error in=w42) -> (code=w43)
        case (w43) {
          frame 501401 {
            # Redirect to Login page
            call "Redirect"(URL="Login.html")
          }
          frame 0, Default {
            # Display Error
            call "Error Handler.gvi"(error in=w42)
          }
        }
        w14 = s1
        w15 = default
      }
      frame "---Copy This Frame---" {
        Merge Errors(w12) -> (error out=w13)
        w14 = s1
        w15 = default
      }
      frame "Exit" {
        # Release the message queue reference
        Release Queue(error in=w12, queue=w9) -> (error out=w44)
        Generate User Event(event data=TRUE, user event=w3) -> (error out=w45)
        Merge Errors(w45, w44) -> (error out=w13)
        # Stop the VI
        w14 = s1
        w15 = TRUE
      }
      frame Default {
        w46 = "The invalid message string \"%s\" was received in the Message Handling Loop."
        Format Into String(formatString=w46, w10) -> w47
        call "Build Error Cluster.gvi"(code=1, description=w47) -> (error out=w13)
        w14 = s1
        w15 = default
      }
    }
    call "Error Handler - Message Handling Loop.gviweb"(message queue in=w9, error in=w13) -> (dup error in=w48)
    next s1 = w14
    stop if w15
  }
  Register For Events("Stop Event"=w3) -> (event registration refnum out=w49)
  s2 = w49  # shift register
  while {
    event (dynamic events = s2) {
      on "Dynamic" Stop Event {
        # The Message Handling Loop processed an "Exit" message, which fired this event to stop the Event Handling Loop.
        w50 = TRUE
        w51 = no error
        w52 = w8
      }
      on "Download" Value changed {
        call "Enqueue Message (Single).gviweb"(message queue in=w8, message="Download Package") -> (message queue out=w52, error out=w51)
        w50 = default
      }
    }
    call "Error Handler - Event Handling Loop.gviweb"(message queue in=w52, error in=w51) -> (dup error in=w53)
    stop if w50
  }
  Unregister For Events(error in=w53, event registration refnum=s2) -> (error out=w54)
  Merge Errors(w54, w48) -> (error out=w55)
  Destroy User Event(error in=w55, user event=w3)
